# Grasshopper definition 230908_CW4.0_WP1.gh (Grasshopper 1.0.7)
# plug-ins: Swiftlet, jSwan

# Logs
# Cleans up script - 08_09_2023 - Javid
# Deployment server on render.com: https://robotlab-residualwood.onrender.com/residual_wood
deployment_server_testing_on_render_com = Panel("https://wood-db.onrender.com/residual_wood")

development_server_on_local_address = Panel("http://127.0.0.1:5001/residual_wood")
get_request = Button()
dam = DataDam(DataURL=deployment_server_testing_on_render_com, DataToggle=get_request, BufferDelay=2500000, BufferMode=0)  # -> DataURL, DataToggle
get = GETRequest(URL=dam.DataURL)  # -> Status, Content, Response
dejson = DeserializeJson(JSON=get.Content, OutputsLocked=True)
dejson_2 = DeserializeJson(JSON=dejson, OutputsLocked=True)  # -> Color, Density, Height, Id, Info, Length, Price, Requirements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

# ----
# to be improved
top = Brep([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])
side = Brep([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])
leg = Geometry([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])
merge = Merge(Data1=top, Data2=side, Data3=leg)
bbox = BoundingBox(Content=merge, Plane=PlaneXY(0, 0, 0))  # -> Box, Box_2

debrep = DeconstructBrep(Brep=bbox.Box)  # -> Faces, Edges, Vertices
sort = SortList(Keys=debrep.Edges)  # -> reverse(Keys), ValuesA
cset = CreateSet(List=sort.Keys)  # -> Set, Map
sort_2 = SortList(Keys=dejson_2.Length, ValuesA=dejson_2.Id, ValuesB=dejson_2.Width)  # -> reverse(Keys), reverse(ValuesA), ValuesB
lengths = ListItem(List=cset.Set, Index=0, Wrap=True)
widths = ListItem(List=cset.Set, Index=Slider(1, range=0..1), Wrap=True)

# ---- group: VISUAL
rectangle = Rectangle(Plane=PlaneXY(0, 0, 0), XSize=dejson_2.Length, YSize=dejson_2.Width, Radius=0)  # -> Rectangle, Length
lng = ListLength(List=dejson_2.Id)
series = Series(Start=0, Step=Slider(171, range=0..200), Count=lng)
boxrec = BoxRectangle(Rectangle=rectangle.Rectangle, Heights=dejson_2.Height)
Y = UnitY(Factor=series)
move = Move(Geometry=boxrec, Motion=Y)  # -> Geometry, Transform
debrep_2 = DeconstructBrep(Brep=move.Geometry)  # -> Faces, Edges, Vertices
volume = Volume(Geometry=move.Geometry)  # -> Volume, Centroid
linedim = LineDimension(Line=debrep_2.Edges, Text="{0:0.00}", Size=Slider(10, range=0..10))
tag = TextTag(Location=volume.Centroid, Text=dejson_2.Id, Colour="#000000")

# ----
tolerance = Slider(5, range=0..10)
form_fitting_push = GhPythonScript(
    stool_parts=bbox.Box,
    lengths_from_db=sort_2.Keys,
    widths_from_db=sort_2.ValuesB,
    stool_pt_lengths=flatten(lengths),
    stool_parts_widths=flatten(widths),
    wood_ids=sort_2.ValuesA,
    verbose=Toggle(True),
    woods=move.Geometry,
    tolerance=tolerance)  # -> message, simplify(graft(removed_ids)), simplify(matched_stool_part_length), amount_per_element, updated_lengths; inputs stool_parts: list, lengths_from_db: list, widths_from_db: list, stool_pt_lengths: list, stool_parts_widths: list, wood_ids: list, woods: list
# ---------- form_fitting_push: Python ----------
import rhinoscriptsyntax as rs
from ghpythonlib import components
from Grasshopper import Kernel
from math import floor
from ghpythonlib import treehelpers as th


class MatchMaker:

    def __init__(
            self,
            stool_parts,
            wood_ids,
            stool_pt_lengths,
            lengths_from_db,
            stool_parts_widths,
            widths_from_db,
            woods,
            tolerance,
            verbose=False
    ):

        self.stool_parts = stool_parts
        self.list_length = len(stool_parts)
        self.lengths_from_db = lengths_from_db
        self.stool_pt_lengths = stool_pt_lengths
        self.stool_parts_widths = stool_parts_widths
        self.widths_from_db = widths_from_db
        self.wood_ids = wood_ids
        self.verbose = verbose
        self.woods = woods
        self.tolerance = tolerance

        self.filtered_ids = []
        self.longest_ids = []
        self.longest_lenghts = []
        self.ape = []

        self.matched_stool_part_length = []
        self.removed_ids = []
        self.removed_lengths = []
        self.selected_ape = []
        self.updated_lengths = []
    
    def run(self):
        count = 0
        iteration = 0
        list_length = len(self.stool_parts)
        while len(self.stool_parts) > 0:
            for i in range(len(self.stool_parts)):
                sub_ = []
                for j in range(len(self.wood_ids)):
                    if self.stool_pt_lengths[i] < self.lengths_from_db[j] and self.stool_parts_widths[i] < \
                            self.widths_from_db[j]:
                        sub_.append(self.wood_ids[j])
                self.filtered_ids.append(sub_)

            if len(self.filtered_ids) > 0:
                for i in range(len(self.filtered_ids)):
                    self.longest_ids.append(self.wood_ids[i])
                    self.longest_lenghts.append(self.lengths_from_db[i])

            for i in range(len(self.longest_lenghts)):
                apes = []
                for j in range(len(self.stool_pt_lengths)):
                    apes.append(floor(self.longest_lenghts[i] / self.stool_pt_lengths[j]))
                self.ape.append(apes)

            selected_ape = [a for a in self.ape[count]][count]
            selected_length = self.longest_lenghts[count]
            x = self.stool_pt_lengths[count:int(selected_ape) + count]

            if x:
                self.matched_stool_part_length.append(x)
                self.removed_ids.append(self.longest_ids[0])
                self.longest_ids.remove(self.longest_ids[0])
                self.removed_lengths.append(self.longest_lenghts[0])
                self.longest_lenghts.remove(self.longest_lenghts[0])
                self.selected_ape.append(selected_ape)

            if count < list_length - 1:
                count += int(selected_ape)
                iteration += 1
                
            try:
                for i in range(count):
                    chunck_lengths = []
                    self.stool_parts.remove(self.stool_parts[i])
                    chunck_lengths.append(x[i])
            except:
                pass
                
            if self.verbose:
                print("Iteration: ", iteration)
                print("list length (stool parts): ", len(self.stool_parts))
                #                print("Longest IDs: ", self.longest_ids[0])
                print("stool part lengths: ", x, "INDEX: ", self.removed_ids[-1])
                print("APE: ", selected_ape)
        print("-" * 80)
        print("Successfully matched design and database parts...")
    
    def get_ape_series(self):
        apes_list = components.MassAddition(self.selected_ape)["partial_results"]
        apes_list.insert(0, 0)
        
        weave = []
        p_1 = apes_list[:-1]
        p_2 = apes_list[1:]
        
        for i in range(len(self.selected_ape)):
            weave.append(range(p_1[i], p_2[i]))
        print("Successfully created series of design element indecies...")
        if self.verbose:
            print("-" * 80)
            print(weave)
        return weave
    
    def evaluate_on_db_wood(self):
        series = self.get_ape_series()
        sum_of_stool_pt_lengths = []
        indecies = []
        
        for i in range(len(series)):
            o = []
            length_sums = []
            for j in series[i]:
                
                if j < self.list_length:
                    o.append(j)
                    length_sums.append(self.stool_pt_lengths[j])
            indecies.append(o)
            sum_of_stool_pt_lengths.append(sum(length_sums) + (self.tolerance * len(length_sums)))
        
        selection_guids = [self.woods[index - 1] for index in self.removed_ids]
        breps = [rs.coercebrep(s) for s in selection_guids]
        exploded = [components.DeconstructBrep(brep) for brep in breps]
        curves = [w.edges[0] for w in exploded]
        
        updated_lengths_list = []
        for i in range(len(self.removed_lengths)):
            updated_lengths_list.append(self.removed_lengths[i] - sum_of_stool_pt_lengths[i])
        
        print("Successfully updated the database wood lengths...")
        if self.verbose:
            print("-" * 80)
            print("New lengths: ", updated_lengths_list)
            print("Updated IDs: ", self.removed_ids)
        
        return th.list_to_tree(updated_lengths_list, 0)

        
        
def main():
    
    global removed_ids
    global removed_lengths
    global matched_stool_part_length
    global amount_per_element
    global updated_lengths

    d = MatchMaker(
        stool_parts=stool_parts,
        wood_ids=wood_ids,
        stool_pt_lengths=stool_pt_lengths,
        lengths_from_db=lengths_from_db,
        stool_parts_widths=stool_parts_widths,
        widths_from_db=widths_from_db,
        woods=woods,
        tolerance=tolerance,
        verbose=verbose
    )

    d.run()
#    d.get_ape_series()
    updated_lengths = d.evaluate_on_db_wood()

    removed_ids = d.removed_ids
    removed_lengths = d.removed_lengths
    matched_stool_part_length = th.list_to_tree(d.matched_stool_part_length, 0)
    amount_per_element = th.list_to_tree(d.selected_ape, 0)

if __name__ == "__main__":
    main()
# ---------- end form_fitting_push ----------
lng_2 = ListLength(List=form_fitting_push.amount_per_element)
ma = MassAddition(Input=flatten(form_fitting_push.amount_per_element))  # -> Result, PartialResults
series_2 = Series(Start=0, Step=1, Count=lng_2)
ins = InsertItems(List=ma.PartialResults, Item="0", Indices="0", Wrap=True)
item = ListItem(List=ins, Index=series_2, Wrap=True)  # -> graft(Item), graft(Item1)
weave = Weave(Pattern=[0, 1], Stream0=item.Item, Stream1=item.Item1, NullGaps=False)
item_2 = ListItem(List=weave, Index=0, Wrap=True)  # -> Item, Item1
subtraction = Subtraction(A=item_2.Item1, B=item_2.Item)
flatten = FlattenTree(Tree=form_fitting_push.removed_ids, Path="{0}")
series_3 = Series(Start=item_2.Item, Step=1, Count=subtraction)
panel = Panel(form_fitting_push.removed_ids)
panel_2 = Panel(form_fitting_push.matched_stool_part_length)
panel_3 = Panel(form_fitting_push.amount_per_element)
panel_4 = Panel(form_fitting_push.updated_lengths)
subtraction_2 = Subtraction(A=flatten, B=1)
number_slider = Slider(0, range=0..100)
item_3 = ListItem(List=merge, Index=series_3, Wrap=True)
item_4 = ListItem(List=move.Geometry, Index=subtraction_2, Wrap=True)
lng_3 = ListLength(List=flatten)
tstat = TreeStatistics(Tree=item_3)  # -> Paths, Length, Count
debrep_3 = DeconstructBrep(Brep=item_4)  # -> Faces, Edges, Vertices
series_4 = Series(Start=0, Step=1, Count=lng_3)
item_5 = ListItem(List=debrep_3.Edges, Index=0, Wrap=True)  # -> simplify(Item)
len = Length(Curve=debrep_3.Edges)
cset_2 = CreateSet(List=len)  # -> Set, Map
addition = Addition(A=form_fitting_push.matched_stool_part_length, B=Slider(5, range=0..10))
item_6 = ListItem(List=tstat.Paths, Index=series_4, Wrap=True)
ma_2 = MassAddition(Input=addition)  # -> Result, PartialResults
item_7 = ListItem(List=cset_2.Set, Index=Slider(2, range=0..10), Wrap=True)
branch = TreeBranch(Tree=item_3, Path=item_6, MaintainPaths=True)
panel_5 = Panel(item_7)
bbox_2 = BoundingBox(Content=branch, Plane=PlaneXY(0, 0, 0))  # -> Box, Box_2
eval = EvaluateCurve(Curve=item_5, Parameter=ma_2.PartialResults)  # -> Point, Tangent, Angle
panel_6 = Panel(ma_2.Result)
debrep_4 = DeconstructBrep(Brep=bbox_2.Box)  # -> Faces, Edges, Vertices
item_8 = ListItem(List=debrep_4.Vertices, Index=0, Wrap=True)
xy = XYPlane(Origin=item_8)
