# Grasshopper definition CW4.0_WP1_WIP.gh (Grasshopper 1.0.7)
# plug-ins: Swiftlet, jSwan, LunchBox, 3D Graphic Statics V02, Pufferfish

tolerance = Slider(4, range=0..10)

top = Brep([<brep referenced from the Rhino model> x5])
leg = Geometry([<brep referenced from the Rhino model> x4])
side = Brep([<brep referenced from the Rhino model> x4])
merge = Merge(Data1=top, Data2=side, Data3=leg)
bbox = BoundingBox(Content=merge, Plane=PlaneXY(0, 0, 0))  # -> Box, Box_2
lng = ListLength(List=bbox.Box)
series = Series(Start=0, Step=1, Count=lng)

# ----
# Development server on local address: https://robotlab-residualwood.onrender.com/residual_wood
development_server_on_local_address = Panel("http://127.0.0.1:5001/residual_wood")
get_request = Button()
dam = DataDam(DataURL=development_server_on_local_address, DataToggle=get_request, BufferDelay=2500000, BufferMode=0)  # -> DataURL, DataToggle
get = GETRequest(URL=dam.DataURL)  # -> Status, Content, Response
dejson = DeserializeJson(JSON=get.Content, OutputsLocked=True)
dejson_2 = DeserializeJson(JSON=dejson, OutputsLocked=True)  # -> Color, Density, Height, Id, Info, Length, Price, Requirements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

# ----
# stack_order_by_wood_id = [2, 5, 6, 7, 10, 11, 13, 31]
# stool_parts = [leg_01, leg_02, leg_03, leg_04, top_01, top_02, top_03, top_04, side_01, side_02, side_03, side_04, top_05]
# ape = [1, 1, 1, 1, 2, 2, 4, 1]
# lengths = [523, 523, 523, 523, 357, 357, 357, 357, 321, 357, 321, 357, 357]
# heights = [17.00, 18.00, 19.00, 18.00, 13.00, 13.00, 13.00, 13.00, 16.00, 16.00, 16.00, 16.00, 14.00]
panel = Panel("""{"id": 2, "ape": 1, "stool_part": [leg_01], "part_lengths": [523]}
{"id": 5, "ape": 1, "stool_part": [leg_02], "part_lengths": [523]}
{"id": 6, "ape": 1, "stool_part": [leg_03], "part_lengths": [523]}
{"id": 7, "ape": 1, "stool_part": [leg_04], "part_lengths": [523]}
{"id": 10, "ape": 2, "stool_part": ["top_01", "top_02"], "part_lengths": [357, 357]},
{"id": 11, "ape": 2, "stool_part": ["top_03", "top_04"], "part_lengths": [357, 357]},
{"id": 13, "ape": 4, "stool_part": ["side_01", "side_02", "side_03", "side_04"], "part_lengths": [321, 357, 321, 357]},
{"id": 31, "ape": 1, "stool_part": ["top_05"], "part_lengths": [357]},""")
debrep = DeconstructBrep(Brep=bbox.Box)  # -> Faces, Edges, Vertices

top_2 = Brep([<brep referenced from the Rhino model> x5])
side_2 = Brep([<brep referenced from the Rhino model> x4])
leg_2 = Geometry([<brep referenced from the Rhino model> x4])

sort = SortList(Keys=debrep.Edges)  # -> reverse(Keys), ValuesA
merge_2 = Merge(Data1=top_2, Data2=side_2, Data3=leg_2)
cset = CreateSet(List=sort.Keys)  # -> Set, Map

# ----
# Use the one with port 5001 for testing
development_server_on_local_address_2 = Panel("http://127.0.0.1:5001/residual_wood")

tolerance_2 = Slider(4, range=0..10)

top_3 = Brep([<brep referenced from the Rhino model> x5])
side_3 = Brep([<brep referenced from the Rhino model> x4])
leg_3 = Geometry([<brep referenced from the Rhino model> x4])
merge_3 = Merge(Data1=top_3, Data2=side_3, Data3=leg_3)
bbox_2 = BoundingBox(Content=merge_3, Plane=PlaneXY(0, 0, 0))  # -> Box, Box_2
lng_2 = ListLength(List=bbox_2.Box)
series_2 = Series(Start=0, Step=1, Count=lng_2)

# ----
# Development server on local address: https://robotlab-residualwood.onrender.com/residual_wood
development_server_on_local_address_3 = Panel("http://127.0.0.1:5001/residual_wood")
get_request_2 = Button()
dam_2 = DataDam(DataURL=development_server_on_local_address_3, DataToggle=get_request_2, BufferDelay=2500000, BufferMode=0)  # -> DataURL, DataToggle
get_2 = GETRequest(URL=dam_2.DataURL)  # -> Status, Content, Response
dejson_3 = DeserializeJson(JSON=get_2.Content, OutputsLocked=True)
dejson_4 = DeserializeJson(JSON=dejson_3, OutputsLocked=True)  # -> Color, Density, Height, Id, Info, Length, Price, Requirements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

panel_2 = Panel(cset.Set)
lengths = ListItem(List=cset.Set, Index=0, Wrap=True)
widths = ListItem(List=cset.Set, Index=Slider(1, range=0..1), Wrap=True)
cluster = Cluster_2(C=top_2, C_2=side_2, C_3=leg_2)  # -> R, number_slider

lng_3 = ListLength(List=top_3)
lng_4 = ListLength(List=side_3)
lng_5 = ListLength(List=leg_3)
max = Maximum(A=lng_3, B=lng_4)
min = Minimum(A=lng_3, B=lng_4)
max_2 = Maximum(A=max, B=lng_5)
min_2 = Minimum(A=min, B=lng_5)

roundd = RoundToDecimalPlace(NumberX=cluster.R, DecimalPlace=cluster.number_slider, RoundType=0)  # -> Rounded, Difference
sort_2 = SortList(Keys=dejson_2.Length, ValuesA=dejson_2.Id, ValuesB=dejson_2.Width)  # -> reverse(Keys), reverse(ValuesA), ValuesB
tolerance_3 = Slider(5, range=0..10)
panel_3 = Panel("""2
5
6
7
10
11
13
31""")

# ---- group: VISUAL
rectangle = Rectangle(Plane=PlaneXY(0, 0, 0), XSize=dejson_2.Length, YSize=dejson_2.Width, Radius=0)  # -> Rectangle, Length
lng_6 = ListLength(List=dejson_2.Id)
series_3 = Series(Start=0, Step=Slider(171, range=0..200), Count=lng_6)
boxrec = BoxRectangle(Rectangle=rectangle.Rectangle, Heights=dejson_2.Height)
Y = UnitY(Factor=series_3)
move = Move(Geometry=boxrec, Motion=Y)  # -> Geometry, Transform
debrep_2 = DeconstructBrep(Brep=move.Geometry)  # -> Faces, Edges, Vertices
volume = Volume(Geometry=move.Geometry)  # -> Volume, Centroid
linedim = LineDimension(Line=debrep_2.Edges, Text="{0:0.00}", Size=Slider(10, range=0..10))
tag = TextTag(Location=volume.Centroid, Text=dejson_2.Id, Colour="#000000")

# ----
form_fitting_push = GhPythonScript(
    stool_parts=bbox.Box,
    lengths_from_db=sort_2.Keys,
    widths_from_db=sort_2.ValuesB,
    stool_pt_lengths=flatten(lengths),
    stool_parts_widths=flatten(widths),
    wood_ids=sort_2.ValuesA,
    verbose=Toggle(False),
    woods=move.Geometry,
    tolerance=tolerance_3)  # -> message, simplify(graft(removed_ids)), simplify(graft(removed_lengths)), simplify(matched_stool_part_length), amount_per_element, updated_lengths; inputs stool_parts: list, lengths_from_db: list, widths_from_db: list, stool_pt_lengths: list, stool_parts_widths: list, wood_ids: list, woods: list
# ---------- form_fitting_push: Python ----------
import rhinoscriptsyntax as rs
from ghpythonlib import components
from Grasshopper import Kernel
from math import floor
from ghpythonlib import treehelpers as th


class MatchMaker:

    def __init__(
            self,
            stool_parts,
            wood_ids,
            stool_pt_lengths,
            lengths_from_db,
            stool_parts_widths,
            widths_from_db,
            woods,
            tolerance,
            verbose=False
    ):

        self.stool_parts = stool_parts
        self.list_length = len(stool_parts)
        self.lengths_from_db = lengths_from_db
        self.stool_pt_lengths = stool_pt_lengths
        self.stool_parts_widths = stool_parts_widths
        self.widths_from_db = widths_from_db
        self.wood_ids = wood_ids
        self.verbose = verbose
        self.woods = woods
        self.tolerance = tolerance

        self.filtered_ids = []
        self.longest_ids = []
        self.longest_lenghts = []
        self.ape = []

        self.matched_stool_part_length = []
        self.removed_ids = []
        self.removed_lengths = []
        self.selected_ape = []
        self.updated_lengths = []
    
    def run(self):
        count = 0
        iteration = 0
        list_length = len(self.stool_parts)
        while len(self.stool_parts) > 0:
            for i in range(len(self.stool_parts)):
                sub_ = []
                for j in range(len(self.wood_ids)):
                    if self.stool_pt_lengths[i] < self.lengths_from_db[j] and self.stool_parts_widths[i] < \
                            self.widths_from_db[j]:
                        sub_.append(self.wood_ids[j])
                self.filtered_ids.append(sub_)

            if len(self.filtered_ids) > 0:
                for i in range(len(self.filtered_ids)):
                    self.longest_ids.append(self.wood_ids[i])
                    self.longest_lenghts.append(self.lengths_from_db[i])

            for i in range(len(self.longest_lenghts)):
                apes = []
                for j in range(len(self.stool_pt_lengths)):
                    apes.append(floor(self.longest_lenghts[i] / self.stool_pt_lengths[j]))
                self.ape.append(apes)

            selected_ape = [a for a in self.ape[count]][count]
            selected_length = self.longest_lenghts[count]
            x = self.stool_pt_lengths[count:int(selected_ape) + count]

            if x:
                self.matched_stool_part_length.append(x)
                self.removed_ids.append(self.longest_ids[0])
                self.longest_ids.remove(self.longest_ids[0])
                self.removed_lengths.append(self.longest_lenghts[0])
                self.longest_lenghts.remove(self.longest_lenghts[0])
                self.selected_ape.append(selected_ape)

            if count < list_length - 1:
                count += int(selected_ape)
                iteration += 1
                
            try:
                for i in range(count):
                    chunck_lengths = []
                    self.stool_parts.remove(self.stool_parts[i])
                    chunck_lengths.append(x[i])
            except:
                pass
                
            if self.verbose:
                print("Iteration: ", iteration)
                print("list length (stool parts): ", len(self.stool_parts))
                #                print("Longest IDs: ", self.longest_ids[0])
                print("stool part lengths: ", x, "INDEX: ", self.removed_ids[-1])
                print("APE: ", selected_ape)
        print("-" * 80)
        print("Successfully matched design and database parts...")
    
    def get_ape_series(self):
        apes_list = components.MassAddition(self.selected_ape)["partial_results"]
        apes_list.insert(0, 0)
        
        weave = []
        p_1 = apes_list[:-1]
        p_2 = apes_list[1:]
        
        for i in range(len(self.selected_ape)):
            weave.append(range(p_1[i], p_2[i]))
        print("Successfully created series of design element indecies...")
        if self.verbose:
            print("-" * 80)
            print(weave)
        return weave
    
    def evaluate_on_db_wood(self):
        series = self.get_ape_series()
        sum_of_stool_pt_lengths = []
        indecies = []
        
        for i in range(len(series)):
            o = []
            length_sums = []
            for j in series[i]:
                
                if j < self.list_length:
                    o.append(j)
                    length_sums.append(self.stool_pt_lengths[j])
            indecies.append(o)
            sum_of_stool_pt_lengths.append(sum(length_sums) + (self.tolerance * len(length_sums)))
        
        selection_guids = [self.woods[index - 1] for index in self.removed_ids]
        breps = [rs.coercebrep(s) for s in selection_guids]
        exploded = [components.DeconstructBrep(brep) for brep in breps]
        curves = [w.edges[0] for w in exploded]
        
        updated_lengths_list = []
        for i in range(len(self.removed_lengths)):
            updated_lengths_list.append(self.removed_lengths[i] - sum_of_stool_pt_lengths[i])
        
        print("Successfully updated the database wood lengths...")
        if self.verbose:
            print("-" * 80)
            print("New lengths: ", updated_lengths_list)
            print("Updated IDs: ", self.removed_ids)
        
        return th.list_to_tree(updated_lengths_list, 0)

        
        
def main():
    
    global removed_ids
    global removed_lengths
    global matched_stool_part_length
    global amount_per_element
    global updated_lengths

    d = MatchMaker(
        stool_parts=stool_parts,
        wood_ids=wood_ids,
        stool_pt_lengths=stool_pt_lengths,
        lengths_from_db=lengths_from_db,
        stool_parts_widths=stool_parts_widths,
        widths_from_db=widths_from_db,
        woods=woods,
        tolerance=tolerance,
        verbose=verbose
    )

    d.run()
#    d.get_ape_series()
    updated_lengths = d.evaluate_on_db_wood()

    removed_ids = d.removed_ids
    removed_lengths = d.removed_lengths
    matched_stool_part_length = th.list_to_tree(d.matched_stool_part_length, 0)
    amount_per_element = th.list_to_tree(d.selected_ape, 0)

if __name__ == "__main__":
    main()
# ---------- end form_fitting_push ----------

first_box = ListItem(List=bbox_2.Box, Index=0, Wrap=True)
cluster_2 = Cluster_3(B=first_box)  # -> i, i_2, i_3
width_filter = SmallerThan(FirstNumber=cluster_2.i_2, SecondNumber=dejson_4.Width)  # -> SmallerThan, OrEqualTo
length_filter = SmallerThan(FirstNumber=cluster_2.i, SecondNumber=dejson_4.Length)  # -> SmallerThan, OrEqualTo
height_filter = SmallerThan(FirstNumber=cluster_2.i_3, SecondNumber=dejson_4.Height)  # -> SmallerThan, OrEqualTo
and = GateAnd(A=width_filter.OrEqualTo, B=length_filter.OrEqualTo)
filtered_ids = CullPattern(List=dejson_4.Id, CullPattern=and)

cull_i = CullIndex(List=dejson_4.Id, Indices=panel_3, Wrap=True)

# ---- group: GET data from DB
# Get API request from Database
panel_4 = Panel("https://wood-db.onrender.com/residual_wood")  # disabled
get_3 = GETRequest(URL=panel_4)  # -> Status, Content, Response; disabled
dejson_5 = DeserializeJson(JSON=get_3.Content, OutputsLocked=True)  # disabled
dejson_6 = DeserializeJson(JSON=dejson_5, OutputsLocked=True)  # -> Color, Density, Height, Id, Info, Length, Price, Requirements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; disabled

# ----
data = Data(form_fitting_push.updated_lengths)
lng_7 = ListLength(List=form_fitting_push.amount_per_element)
ma = MassAddition(Input=flatten(form_fitting_push.amount_per_element))  # -> Result, PartialResults
panel_5 = Panel("lengths = [339, 339, 339, 339, 339, 312, 339, 312, 339, 497, 497, 497, 497]")
panel_6 = Panel("heights = [16.00, 16.00, 16.00, 16.00, 16.00, 15.00, 15.00, 15.00, 15.00, 23.00, 23.00, 20.00, 20.00]")
panel_7 = Panel("stool_parts = [top_01, top_02, top_03, top_04, top_05, side_01, side_02, side_03,  side_04, leg_01, leg_02, leg_03, leg_04, ]")
panel_8 = Panel("ape = [5, 4, 2, 2]")
panel_9 = Panel("stack_order_by_wood_id = [36, 37, 38, 39]")
series_4 = Series(Start=0, Step=1, Count=lng_7)
ins = InsertItems(List=ma.PartialResults, Item="0", Indices="0", Wrap=True)
panel_10 = Panel(form_fitting_push.message)
item = ListItem(List=ins, Index=series_4, Wrap=True)  # -> graft(Item), graft(Item1)
weave = Weave(Pattern=[0, 1], Stream0=item.Item, Stream1=item.Item1, NullGaps=False)
item_2 = ListItem(List=weave, Index=0, Wrap=True)  # -> Item, Item1

# ---- group: VISUAL
rectangle_2 = Rectangle(Plane=PlaneXY(0, 0, 0), XSize=dejson_4.Length, YSize=dejson_4.Width, Radius=0)  # -> Rectangle, Length
lng_8 = ListLength(List=dejson_4.Id)
series_5 = Series(Start=0, Step=Slider(171, range=0..200), Count=lng_8)
boxrec_2 = BoxRectangle(Rectangle=rectangle_2.Rectangle, Heights=dejson_4.Height)
Y_2 = UnitY(Factor=series_5)
move_2 = Move(Geometry=boxrec_2, Motion=Y_2)  # -> Geometry, Transform
debrep_3 = DeconstructBrep(Brep=move_2.Geometry)  # -> Faces, Edges, Vertices
volume_2 = Volume(Geometry=move_2.Geometry)  # -> Volume, Centroid
linedim_2 = LineDimension(Line=debrep_3.Edges, Text="{0:0.00}", Size=Slider(10, range=0..10))
tag_2 = TextTag(Location=volume_2.Centroid, Text=dejson_4.Id, Colour="#000000")

# ----
subtraction = Subtraction(A=item_2.Item1, B=item_2.Item)
flatten = FlattenTree(Tree=form_fitting_push.removed_ids, Path="{0}")
series_6 = Series(Start=item_2.Item, Step=1, Count=subtraction)
panel_11 = Panel(series_6)
geo = Geometry(merge)
subtraction_2 = Subtraction(A=flatten, B=1)
number_slider = Slider(0, range=0..100)
item_3 = ListItem(List=merge, Index=series_6, Wrap=True)
item_4 = ListItem(List=move.Geometry, Index=subtraction_2, Wrap=True)
lng_9 = ListLength(List=flatten)
addition = Addition(A=form_fitting_push.matched_stool_part_length, B=Slider(5, range=0..10))
tstat = TreeStatistics(Tree=item_3)  # -> Paths, Length, Count
debrep_4 = DeconstructBrep(Brep=item_4)  # -> Faces, Edges, Vertices

usable_woods_range = ListItem(List=move_2.Geometry, Index=expr("x - 1", filtered_ids), Wrap=True)
lengths_2 = ListItem(List=dejson_4.Length, Index=expr("x - 1", filtered_ids), Wrap=True)
preview = CustomPreview(Geometry=usable_woods_range, Material=ColourSwatch(SwatchColor=RGBA(168, 158, 230, 189)))
database_part_lengths = Data(lengths_2)
design_part_length = Data(cluster_2.i)
division = Division(A=database_part_lengths, B=design_part_length)
sort_3 = SortList(Keys=division, ValuesA=filtered_ids, ValuesB=database_part_lengths)  # -> reverse(Keys), reverse(ValuesA), reverse(ValuesB)
ape = ListItem(List=sort_3.Keys, Index=0, Wrap=True)
id = ListItem(List=sort_3.ValuesA, Index=0, Wrap=True)
db_length = ListItem(List=sort_3.ValuesB, Index=0, Wrap=True)
round = Round(Number=ape)  # -> Nearest, Floor, Ceiling
smaller = SmallerThan(FirstNumber=round.Floor, SecondNumber=max_2)  # -> SmallerThan, OrEqualTo
cull = CullPattern(List=round.Floor, CullPattern=smaller.OrEqualTo)
selection = ListItem(List=move_2.Geometry, Index=expr("x - 1", id), Wrap=True)
des_index = Series(Start=0, Step=1, Count=cull)

series_7 = Series(Start=0, Step=1, Count=lng_9)
item_5 = ListItem(List=tstat.Paths, Index=series_7, Wrap=True)
len = Length(Curve=debrep_4.Edges)
item_6 = ListItem(List=debrep_4.Edges, Index=0, Wrap=True)  # -> simplify(Item)
cset_2 = CreateSet(List=len)  # -> Set, Map
branch = TreeBranch(Tree=item_3, Path=item_5, MaintainPaths=True)
ma_2 = MassAddition(Input=addition)  # -> Result, PartialResults
bbox_3 = BoundingBox(Content=branch, Plane=PlaneXY(0, 0, 0))  # -> Box, Box_2
item_7 = ListItem(List=cset_2.Set, Index=Slider(2, range=0..10), Wrap=True)
debrep_5 = DeconstructBrep(Brep=bbox_3.Box)  # -> Faces, Edges, Vertices
panel_12 = Panel(ma_2.Result)
panel_13 = Panel(item_7)
item_8 = ListItem(List=debrep_5.Vertices, Index=0, Wrap=True)
eval = EvaluateCurve(Curve=item_6, Parameter=ma_2.PartialResults)  # -> Point, Tangent, Angle
xy = XYPlane(Origin=item_8)

series_8 = Series(Start=0, Step=1, Count=round.Floor)
item_9 = ListItem(List=bbox_2.Box, Index=series_8, Wrap=True)
debrep_6 = DeconstructBrep(Brep=item_9)  # -> Faces, Edges, Vertices
len_2 = Length(Curve=debrep_6.Edges)
sort_4 = SortList(Keys=len_2)  # -> Keys, ValuesA
item_10 = ListItem(List=reverse(sort_4.Keys), Index=0, Wrap=True)
flatten_2 = FlattenTree(Tree=item_10, Path="{0}")
ma_3 = MassAddition(Input=flatten_2)  # -> Result, PartialResults
remained_length = Subtraction(A=db_length, B=ma_3.Result)
remained_length_2 = Data(remained_length)

cull_i_2 = CullIndex(List=bbox_2.Box, Indices=des_index, Wrap=True)
cull_i_3 = CullIndex(List=series_2, Indices=des_index, Wrap=True)
remained_indecies = SetDifference(SetA=series_2, SetB=des_index)

debrep_7 = DeconstructBrep(Brep=selection)  # -> Faces, Edges, Vertices
reference_boxes = ListItem(List=bbox_2.Box, Index=des_index, Wrap=True)
len_3 = Length(Curve=debrep_7.Edges)
debrep_8 = DeconstructBrep(Brep=reference_boxes)  # -> Faces, Edges, Vertices
sort_5 = SortList(Keys=len_3, ValuesA=debrep_7.Edges)  # -> Keys, ValuesA
len_4 = Length(Curve=debrep_8.Edges)
debrep_9 = DeconstructBrep(Brep=reference_boxes)  # -> Faces, Edges, Vertices
sort_6 = SortList(Keys=len_4, ValuesA=debrep_8.Edges)  # -> Keys, ValuesA
item_11 = ListItem(List=reverse(sort_6.Keys), Index=0, Wrap=True)
item_12 = ListItem(List=debrep_9.Vertices, Index=Slider(2, range=0..8), Wrap=True)
flatten_3 = FlattenTree(Tree=item_11, Path="{0}")
addition_2 = Addition(A=flatten_3, B=tolerance_2)
item_13 = ListItem(List=reverse(sort_5.ValuesA), Index=0, Wrap=True)
ma_4 = MassAddition(Input=addition_2)  # -> Result, PartialResults
pflip = FlipPlane(Plane=item_12, ReverseX=Toggle(False), ReverseY=Toggle(False), SwapAxes=Toggle(True))
eval_2 = EvaluateLength(Curve=item_13, Length=ma_4.PartialResults, Normalized=invert(True))  # -> Point, Tangent, Parameter
orient = Orient(Geometry=reference_boxes, Source=flatten(pflip), Target=eval_2.Point)  # -> Geometry, Transform
height = ListItem(List=dejson_4.Height, Index=expr("x - 1", id), Wrap=True)

development_server = Panel("http://127.0.0.1:5001/residual_wood/")
ids_rollback = Data(dejson_4.Id)
id_2 = Data(id)
number_slider_2 = Slider(105, range=0..1000)  # disabled
number_slider_3 = Slider(36, range=0..100)  # disabled

item_14 = ListItem(List=sort_6.Keys, Index=0, Wrap=True)
flatten_4 = FlattenTree(Tree=item_14, Path="{0}")
debrep_10 = DeconstructBrep(Brep=orient.Geometry)  # -> Faces, Edges, Vertices
item_15 = ListItem(List=debrep_10.Faces, Index=Slider(4, range=0..10), Wrap=True)
area = Area(Geometry=item_15)  # -> Area, flatten(Centroid)
division_2 = Division(A=height, B=flatten_4)
scale_nu = ScaleNU(Geometry=orient.Geometry, Plane=area.Centroid, ScaleX=1, ScaleY=1, ScaleZ=division_2)  # -> Geometry, Transform
orient_2 = Orient(Geometry=scale_nu.Geometry, Source=flatten(eval_2.Point), Target=flatten(pflip))  # -> Geometry, Transform
data_2 = Data(merge_3)
parts_to_morph = ListItem(List=data_2, Index=des_index, Wrap=True)
Y_3 = UnitY(Factor=Slider(844, range=0..10000))
new_position_of_design = Move(Geometry=orient_2.Geometry, Motion=Y_3)  # -> Geometry, Transform
updated_design_shape = BoxMapping(Geometry=parts_to_morph, Source=reference_boxes, Target=new_position_of_design.Geometry)  # -> Geometry, Transform
preview_2 = CustomPreview(Geometry=updated_design_shape.Geometry, Material=ColourSwatch(SwatchColor=RGBA(229, 99, 255, 26)))

number_slider_4 = Slider(105, range=0..1000)  # disabled
subtraction_3 = Subtraction(A=number_slider_2, B=number_slider_3)  # disabled
panel_14 = Panel("/")  # disabled
series_9 = Series(Start=number_slider_3, Step=1, Count=subtraction_3)  # disabled
concat = Concatenate(FragmentA=development_server_on_local_address_3, FragmentB=panel_14, FragmentC=number_slider_4)  # disabled
delete = DELETERequest(URL=concat)  # -> Status, Content, Response; disabled

# ----
# Scenario 1 (PULL)
slider = Slider(150, range=1..1000)
python = GhPythonScript(x=slider)  # -> out, a; inputs x: Int32; disabled
# ---------- python: Python ----------
from datetime import datetime

a = []
for i in range(x):
    a.append(datetime.now().strftime("%Y-%m-%d %H:%M:%S"))
# ---------- end python ----------
cluster_3 = Cluster(count=slider)  # -> genelist_a_2, genelist_b_2, genelist_c_2, C, genelist_g_2
number_slider_5 = Slider(6, range=0..10)  # disabled
srf = Surface(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)  # disabled
diagrid = DiagridStructure(Surface=srf, UDivisions=number_slider_5, VDivisions=number_slider_5, Type=True)  # -> StructureLines, StructureNodes; disabled
item_16 = ListItem(List=dejson_5, Index=0, Wrap=True)  # -> Item1, Item; disabled
panel_15 = Panel(item_16.Item1)  # disabled
crv = Curve([<curve referenced from the Rhino model> x2])  # disabled

multiplication = Multiplication(A=cluster_3.genelist_a_2, B=cluster_3.genelist_b_2, C=cluster_3.genelist_c_2)  # disabled
division_3 = Division(A=multiplication, B=10000000)  # disabled
division_4 = Division(A=cluster_3.genelist_g_2, B=1000)  # disabled
division_5 = Division(A=division_4, B=division_3)  # disabled

# ---- group: POST data to DB
# Post API call  to Database
# DB Schema updated
entwine = Entwine(
    Branch00=cluster_3.genelist_a_2,
    Branch01=cluster_3.genelist_b_2,
    Branch02=cluster_3.genelist_c_2,
    Branch03=cluster_3.genelist_g_2,
    Branch04=division_5,
    Branch05=cluster_3.C,
    Branch06=python.a,
    FlattenInputs=True)  # -> simplify(Result); disabled
flip = FlipMatrix(Data=entwine)  # disabled
panel_16 = Panel("""id
length
width
height
weight
density
color
timestamp
info
requirements
reserved
reservation_name
reservation_time
source
price""")
rejsonkv = SerializeKeysAndValues(Key=panel_16)  # -> flatten(JSON); disabled
panel_17 = Panel("https://wood-db.onrender.com/residual_wood")  # disabled
get_string = GetString(rejsonkv, AtLeast=1, AtMost=2147483647, TreeAccess=False)  # disabled
ctb = CreateTextBody(
    Content=get_string,
    IsHtmlChecked=False,
    IsJavascriptChecked=False,
    IsJsonChecked=True,
    IsTextChecked=False,
    IsXmlChecked=False)  # disabled
post = POSTRequest(URL=panel_17, Body=ctb)  # -> Status, Content, Response; disabled

# ----
# Selection from Database based on Nearest Length
len_5 = Length(Curve=crv)  # disabled
data_3 = Data(len_5)  # disabled
sort_7 = SortList(Keys=data_3, ValuesA=crv)  # -> Keys, ValuesA; disabled
python_2 = GhPythonScript(design_lengths=sort_7.Keys, database_lengths=dejson_6.Length)  # -> nearest_lengths; inputs design_lengths: list, database_lengths: list; disabled
# ---------- python_2: Python ----------
__author__ = "Javid Jooshesh, j.jooshesh@hva.nl"
__version__ = "v1"


def find_closest_members(array1, array2):
    closest_members = []
    for value in array1:
        nearest_value = min(array2, key=lambda x: abs(x - value))
        closest_members.append(nearest_value)
    return closest_members
    

nearest_lengths = find_closest_members(design_lengths, database_lengths)
# ---------- end python_2 ----------
keysearch = KeyValueSearch(Keys=dejson_6.Length, Values=dejson_6.Id, Search=python_2)  # disabled
index = ItemIndex(List=dejson_6.Id, Item=keysearch)  # disabled
item_17 = ListItem(List=dejson_5, Index=index, Wrap=True)  # disabled
dejson_7 = DeserializeJson(JSON=item_17, OutputsLocked=True)  # -> Color, Density, Height, Id, Info, Length, Price, Requirements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; disabled

# ----
# Wood from Database
number_slider_6 = Slider(242, range=0..1200)  # disabled
number_slider_7 = Slider(100, range=0..100)  # disabled
lng_10 = ListLength(List=dejson_7.Id)  # disabled
pt = ConstructPoint(XCoordinate=0, YCoordinate=expr("x*2", number_slider_7), ZCoordinate=0)  # disabled
series_10 = Series(Start=0, Step=number_slider_6, Count=lng_10)  # disabled
Y_4 = UnitY(Factor=series_10)  # disabled
move_3 = Move(Geometry=pt, Motion=Y_4)  # -> Geometry, Transform; disabled
rectangle_3 = Rectangle(Plane=move_3.Geometry, XSize=dejson_7.Length, YSize=dejson_7.Width, Radius=0)  # -> Rectangle, Length; disabled
boxrec_3 = BoxRectangle(Rectangle=rectangle_3.Rectangle, Height=dejson_7.Height)  # disabled

length_tolerance = Slider(10, range=0..10)  # disabled
ratio = Slider(8.895, range=0..10)  # disabled
python_3 = GhPythonScript(
    wood_from_db=boxrec_3,
    design_boundary=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,
    heights=dejson_7.Height,
    line_segment=crv,
    tolerane=length_tolerance,
    ratio_tolerance=ratio)  # -> all_blocks, normal, linear_indecies, ratios, available_length; inputs wood_from_db: list, heights: list, line_segment: list; disabled
# ---------- python_3: Python ----------
"""__author__ = "Javid Jooshesh, j.jooshesh@hva.nl"
__version__ = "v1"
"""
import ghpythonlib.treehelpers as th
import rhinoscriptsyntax as rs
import Grasshopper.Kernel.Data as ghp
import Grasshopper.Kernel.Geometry.Plane as gh_plane


class Blocks:
    """_Class representing the wood plank geometries from the database_
    Attributes:
        source (DataTree[Breps]) : The list of box breps as a Grasshopper
            datatree
    Methods:
        explode_polysrf: ...
        explode_srf: ...
        get_block_length: ...
        get_block_width: ...
    """

    def __init__(self, source):
        """_Constructor of the class_
        Args:
            source (DataTree[objectid]) : The list of box breps
                as a Grasshopper datatree
        """

        self.source = source

    def __str__(self):
        return "A Class to Represent the Functions of " \
               "Form-Fitting for the Circular Wood Blocks from Scanned Database"

    def explode_polysrf(self):
        """Explode a brep object into the NURBS untrimmed surfaces"""
        p = []
        for i in range(len(self.source)):
            trimmed_srf = rs.ExplodePolysurfaces(self.source[i])
            blocks = []
            for srf in trimmed_srf:
                blocks.append(srf)
            p.append(blocks)
        data = th.list_to_tree(p, source=[0])
        return data

    def explode_srf(self):
        """Explode the surface into line segments"""
        p = []
        listed_tree = th.tree_to_list(self.explode_polysrf())
        curve = None
        for i in range(len(listed_tree)):
            curve_segments = []
            for j in range(len(listed_tree[i])):
                curve = rs.DuplicateEdgeCurves(listed_tree[i][j])
                curve_segments.append(curve)
            p.append(curve_segments)
        data = th.list_to_tree(p, source=[0])
        return data

    def get_block_length(self, position=2):
        """Return the length of the block as float. BigO(n^2)
            (not the most efficient way but it works for now)
        """
        list_of_lengths = []
        curves = th.tree_to_list(self.explode_srf())
        for i in range(len(curves)):
            blocks = []
            for j in range(len(curves[i])):
                lengths = []
                for k in range(len(curves[i][j])):
                    l = rs.CurveLength(curves[i][j][k])
                    lengths.append(l)
            blocks.append(sorted(lengths)[position])
            list_of_lengths.append(blocks)

        lengths_data_tree = th.list_to_tree(list_of_lengths, source=[0])
        return lengths_data_tree

    def get_block_width(self, position=1):
        """Return the width of the block as float"""
        widths = self.get_block_length(position=position)
        return widths
        
    def get_block_height(self, position=3):
        heights = self.get_block_length(position=position)
        return heights
    
    
class DesignModel:
    """_Class representing the design object and methods to fit the wood planks
    that are varaible in dimensions, within the boundary of the design_

    Attributes:
        design_region (DesignRegion) : The boundary of design
        blocks (Blocks) : The box breps representing the wood planks from the
            database
    Methods:
        orient: ...
        fit_blocks: ...
    """

    def __init__(self, design_region, blocks, heights, srf_index):
        """_Constructor method_"""

        self.region = DesignRegion(design_region, 0)
        self.srf_index = srf_index
        self.blocks = Blocks(blocks)
        self.blocks_length = self.blocks.get_block_length()
        self.blocks_width = self.blocks.get_block_width()
        self.blocks_height = heights
        self.index_list = []
        self.selection = []
        self.flatten_values()
    
    def flatten_values(self):
        """_Flatten the Length, Width and Height values_"""
        
        flatten_path_width = ghp.GH_Path(0)
        self.blocks_width.Flatten(flatten_path_width)
        flatten_path_length = ghp.GH_Path(0)
        self.blocks_length.Flatten(flatten_path_length)
        flatten_path_height = ghp.GH_Path(0)
        self.blocks_length.Flatten(flatten_path_height)


class DesignRegion:
    def __init__(self, brep, index):
        self.brep = brep
        self.index = index

    def explode(self):
        return rs.ExplodePolysurfaces(self.brep)

    def select_lowest_face(self):
        """Sort the faces of the Brep according to lowest `z` value of the
            centroids
        """
        exploded_surfaces = self.explode()
        z_coords = list()
        lowest_srf = None
        for i in range(len(exploded_surfaces)):
            centriod = rs.SurfaceAreaCentroid(exploded_surfaces[i])
            z_values = centriod[0][2]
            z_coords.append(z_values)
            if z_values == min(z_coords):
                lowest_srf = exploded_surfaces[i]
        return lowest_srf
    
    def select_custom_face(self, selected_index):
        exploded_surfaces = self.explode()
        for index, item in enumerate(exploded_surfaces):
            if index == selected_index:
                return item
    
    def find_edge(self, edge_index, surface_index):
        """Get the edge to populate blocks across within the design boundary"""
        selected_face = self.select_custom_face(surface_index)
        for index, item in enumerate(rs.DuplicateEdgeCurves(selected_face)):
            if index == edge_index:
                return item
                

class LinearElement:
    def __init__(self, line, blocks, used_blocks_index):
        self.blocks = Blocks(blocks)
        self.line = []
        for l in line:
            self.line.append(l)

        self.length = [rs.CurveLength(l) for l in self.line]
        self.start_point = [rs.CurvePoints(l)[0] for l in self.line]
        self.end_point = [rs.CurvePoints(l)[1] for l in self.line]
        self.normal_axis = []
        self.normal = []

        for i in range(len(self.start_point)):
            self.normal_axis.append(rs.VectorCreate(self.end_point[i], self.start_point[i]))
            self.normal.append(rs.PlaneFromNormal(self.start_point[i], self.normal_axis[i]))
        self.selection = []
        self.index_list = []
        self.used_index = used_blocks_index
        self.base = None
            
    def filter_used_blocks(self):
        unused_indexes = []
        for index in range(len(self.blocks.source)):
            if index in self.used_index:
                continue
            unused_indexes.append(index)
        return unused_indexes
    
    def pick_element(self, available_length, tolerane, r_tolerance):
        """_Select elements to build linear parts. Check the ratio
            of width and height as well_"""

        blocks_dict = {}    # blocks_dict = {lengths: blocks}
        lengths = th.tree_to_list(self.blocks.get_block_length())   # Python list
        
        filtered_blocks = self.filter_used_blocks()
        list_of_available_blocks = [self.blocks.source[i] for i in filtered_blocks]

        self.base = [rs.ExplodePolysurfaces(b)[1] for b in list_of_available_blocks]
        heights = [rs.SurfaceDomain(b, 1)[1] for b in self.base]
        widths = [rs.SurfaceDomain(b, 0)[1] for b in self.base]

        ratio = [widths[i] / heights[i] for i in range(len(heights))]

        for i in range(len(list_of_available_blocks)):
            if 0.5 < ratio[i] < r_tolerance:
                length = lengths[i][0]
                blocks_dict[length] = list_of_available_blocks[i]

        length_range = [range(int(l - (tolerane * 2)), int(l + (tolerane * 2))) for l in available_length]
        print(blocks_dict)
        block_list = []
        for i in range(len(length_range)):
            inner = []
            for key, value in blocks_dict.items():
                if int(key) in length_range[i]:
                    inner.append((value, key))
                    
                    self.selection.append(value)
                    del blocks_dict[key]
                    for index, item in enumerate(list_of_available_blocks):
                        if item == value:
                            self.index_list.append(index)
            block_list.append(inner)
#            print(inner)
        return th.list_to_tree(block_list[:], source=[0])


def main():
    global ratios
    global all_blocks
    global normal
    global linear_indecies
    global available_length
    
    test = DesignModel(design_boundary, wood_from_db, heights, 5)
    print(test)
    all_blocks = test.blocks.source
    packed_indecies = test.index_list
    packed_selection = test.selection

    normal = []
    li = []

    a = LinearElement(line_segment, wood_from_db, packed_indecies)
    available_length = []
        
    for i in line_segment:
        available_length.append(rs.CurveLength(i))

    ratios = a.pick_element(available_length, tolerane, ratio_tolerance)
    normal.append(a.normal)
    li.append(a.index_list)

    linear_indecies = th.list_to_tree(li, source=[0])
    linear_selection = a.selection
    normal = th.list_to_tree(normal, source=[0])


if __name__ == "__main__":
    main()
# ---------- end python_3 ----------

lng_11 = ListLength(List=crv)  # disabled
series_11 = Series(Start=0, Step=1, Count=lng_11)  # disabled
item_18 = ListItem(List=python_3.linear_indecies, Index=series_11, Wrap=True)  # disabled

# ---- group: GET data from DB
# Get the reserved data from the Residual Wood REST API
# 25 ms
development_server_on_local_address_4 = Panel("http://127.0.0.1:5000/residual_wood")
production_server_url = Panel("https://robotlab-residualwood.onrender.com/residual_wood")
get_request_3 = Button()

# ----
dam_3 = DataDam(DataURL=production_server_url, DataC=get_request_3, DataA=Button(), BufferDelay=2500000, BufferMode=0)  # -> DataURL, DataC, DataA
get_4 = GETRequest(URL=dam_3.DataURL)  # -> Status, Content, Response
dejson_8 = DeserializeJson(JSON=get_4.Content, OutputsLocked=False)
number_slider_8 = Slider(3, range=0..10)
dejsonkv = DeserializeKeysAndValues(JSON=dejson_8)  # -> Key, Value
cull_i_4 = CullIndex(List=dejsonkv.Value, Indices=number_slider_8, Wrap=True)
cull_i_5 = CullIndex(List=dejsonkv.Key, Indices=number_slider_8, Wrap=True)
rejsonkv_2 = SerializeKeysAndValues(Key=cull_i_5, Value=cull_i_4)  # -> flatten(JSON)
get_string_2 = GetString(rejsonkv_2, AtLeast=1, AtMost=1, TreeAccess=False)
ctb_2 = CreateTextBody(
    Content=get_string_2,
    IsHtmlChecked=False,
    IsJavascriptChecked=False,
    IsJsonChecked=True,
    IsTextChecked=False,
    IsXmlChecked=False)

# ---- group: Data to rollback changes
data_4 = Data(simplify(graft(ctb_2)))

# ----
data_rollb = Data(simplify(graft(ctb_2)))
panel_18 = Panel(data_rollb)

# ----
# Scenario 2 (PUSH)
design_element_index = Slider(0, range=0..12)
milling_bit_radius = Slider(2, range=1..10)
bbox_4 = BoundingBox(Content=merge_2, Plane=PlaneXY(0, 0, 0))  # -> Box, Box_2

# ---- group: Lenght of pieces
debrep_11 = DeconstructBrep(Brep=bbox_4.Box)  # -> Faces, Edges, Vertices
len_6 = Length(Curve=debrep_11.Edges)
cset_3 = CreateSet(List=len_6)  # -> Set, Map
sort_8 = SortList(Keys=cset_3.Set)  # -> Keys, ValuesA

# ---- group: GET data from DB (continued)
dam_4 = DataDam(
    DataA=design_element_index,
    DataURL=development_server_on_local_address_2,
    DataC=get_request_3,
    BufferDelay=2500000,
    BufferMode=0)  # -> DataA, DataURL, DataC
get_5 = GETRequest(URL=dam_4.DataURL)  # -> Status, Content, Response
dejson_9 = DeserializeJson(JSON=get_5.Content, OutputsLocked=True)
dejson_10 = DeserializeJson(JSON=dejson_9, OutputsLocked=True)  # -> Color, Density, Height, Id, Info, Length, Price, Requirements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

# ---- group: Lengths
item_19 = ListItem(List=reverse(sort_8.Keys), Index=0, Wrap=True)  # -> flatten(Item)

# ---- group: Width
item_20 = ListItem(List=reverse(sort_8.Keys), Index=1, Wrap=True)  # -> flatten(Item)

# ---- group: Thickness
item_21 = ListItem(List=reverse(sort_8.Keys), Index=2, Wrap=True)  # -> flatten(Item)

# ---- group: Pre-selection from width / Width of Design element
item_22 = ListItem(List=item_20, Index=design_element_index, Wrap=True)

# ---- group: Visualizing design
addition_3 = Addition(A=design_element_index, B=1)
series_12 = Series(Start=0, Step=1, Count=addition_3)  # -> flatten(Series)
cull_i_6 = CullIndex(List=flatten(merge_2), Indices=series_12, Wrap=True)
preview_3 = CustomPreview(Geometry=cull_i_6, Material=ColourSwatch(SwatchColor=RGBA(170, 0, 255, 90)))

# ---- group: Length of Design element
item_23 = ListItem(List=item_19, Index=design_element_index, Wrap=True)

# ---- group: Tree mask
concat_2 = Concatenate(FragmentA="{", FragmentB=design_element_index, FragmentC=";*}")

# ----
id_3 = Slider(3, range=0..10)
item_24 = ListItem(List=dejson_9, Index=expr("x - 1", id), Wrap=True)
dejsonkv_2 = DeserializeKeysAndValues(JSON=item_24)  # -> Key, Value
cull_i_7 = CullIndex(List=dejsonkv_2.Key, Indices=id_3, Wrap=True)
cull_i_8 = CullIndex(List=dejsonkv_2.Value, Indices=id_3, Wrap=True)
key = Panel("length")
keysearch_2 = KeyValueSearch(Keys=cull_i_7, Values=cull_i_8, Search=key)
index_2 = ItemIndex(List=cull_i_8, Item=keysearch_2)
development_server_2 = Panel("http://127.0.0.1:5001/residual_wood/")
replace = ReplaceItems(List=cull_i_8, Item=remained_length_2, Indices=index_2, Wrap=False)
rejsonkv_3 = SerializeKeysAndValues(Key=cull_i_7, Value=replace)
get_string_3 = GetString(rejsonkv_3, AtLeast=1, AtMost=2147483647, TreeAccess=False)
ctb_3 = CreateTextBody(
    Content=get_string_3,
    IsHtmlChecked=False,
    IsJavascriptChecked=False,
    IsJsonChecked=True,
    IsTextChecked=False,
    IsXmlChecked=False)
panel_19 = Panel(replace)
concat_3 = Concatenate(FragmentA=development_server_2, FragmentB=ids_rollback)  # -> graft(Result)
flatten_5 = FlattenTree(Tree=concat_3, Path="{0}")
panel_20 = Panel(flatten_5)

# ----
# 50 ms
# Once ready, click the Datadam
# to update the database
dam_5 = DataDam(DataB=concat_3, DataA=data_rollb, BufferDelay=5000000, BufferMode=0)  # -> DataB, DataA, DataC
put = PUTRequest(URL=dam_5.DataB, Body=dam_5.DataA)  # -> Status, Content, flatten(Response); disabled
panel_21 = Panel(put.Response)

# ---- group: API call to remove the used wood based on ID
# DELETE from Database
panel_22 = Panel("https://wood-db.onrender.com/residual_wood")  # disabled
panel_23 = Panel("/")  # disabled

# ---- group: VISUAL
lng_12 = ListLength(List=dejson_10.Id)
rectangle_4 = Rectangle(Plane=PlaneXY(0, 0, 0), XSize=dejson_10.Length, YSize=dejson_10.Width, Radius=0)  # -> Rectangle, Length
series_13 = Series(Start=0, Step=Slider(171, range=0..200), Count=lng_12)
boxrec_4 = BoxRectangle(Rectangle=rectangle_4.Rectangle, Heights=dejson_10.Height)
Y_5 = UnitY(Factor=series_13)
move_4 = Move(Geometry=boxrec_4, Motion=Y_5)  # -> Geometry, Transform
preview_4 = CustomPreview(Geometry=move_4.Geometry, Material=dejson_10.Color)

# ---- group: Pre-selection from width
smaller_2 = SmallerThan(FirstNumber=item_22, SecondNumber=dejson_10.Width)  # -> SmallerThan, OrEqualTo
cull_2 = CullPattern(List=move_4.Geometry, CullPattern=smaller_2.OrEqualTo)
cull_3 = CullPattern(List=dejson_10.Id, CullPattern=smaller_2.OrEqualTo)

# ---- group: VISUAL (continued)
volume_3 = Volume(Geometry=cull_2)  # -> Volume, Centroid
debrep_12 = DeconstructBrep(Brep=cull_2)  # -> Faces, Edges, Vertices
linedim_3 = LineDimension(Line=debrep_12.Edges, Text="{0:0.00}", Size=Slider(10, range=0..10))
tag_3 = TextTag(Location=volume_3.Centroid, Text=cull_3, Colour="#000000")

# ---- group: DB elements (geometries)
data_5 = Data(cull_2)

# ----
cull_4 = CullPattern(List=dejson_10.Length, CullPattern=smaller_2.OrEqualTo)
python_4 = GhPythonScript(design_elements=item_19, database_elements=cull_4, bit_diameter=milling_bit_radius)  # -> guide, simplify(index_list); inputs design_elements: list, database_elements: list
# ---------- python_4: Python ----------
"""__author__ = "Javid Jooshesh, j.jooshesh@hva.nl"
__version__ = "v1"
"""

import rhinoscriptsyntax as rs
import Grasshopper.DataTree as dt
import ghpythonlib.treehelpers as th

pairs = []

for i in range(len(database_elements)):
    for j in range(len(design_elements)):
        if database_elements[i] / (design_elements[j] + bit_diameter) >= 1:
            pairs.append(
                (i, j, float(
                    database_elements[i] / (design_elements[j] + bit_diameter)
                )
            )
        )
            
dic = {}

# Hashtable
for i in range(len(design_elements)):
    dic[i] = []
    
for i in range(len(pairs)):
    if pairs[i][1] in dic.keys():
        dic[pairs[i][1]].append(
            (pairs[i][0], pairs[i][2])
        ) if pairs[i][2] >= 1 else None

index_list = th.list_to_tree(
    [
        dic[i] for i in range(len(design_elements))
    ], source=[0]
)

msg = "Database Index: {0}, Design Element Index: {1}, Amounts per Element: {2}"
for i in range(len(pairs)):
    a = pairs[i][0]
    b = pairs[i][1]
    c = pairs[i][2]
    print(msg.format(a, b, c))
# ---------- end python_4 ----------
panel_24 = Panel(python_4.guide)
split = SplitTree(Data=python_4.index_list, Masks=flatten(concat_2))  # -> Positive, Negative
info = ListItem(List=split.Positive, Index=0, Wrap=True)  # -> Item, Item1
item_25 = ListItem(List=cull_4, Index=flatten(info.Item), Wrap=True)

# ---- group: Amounts per Elements
data_6 = Data(info.Item1)

# ----
toint = RoundToInteger(Number=data_6)  # -> NumClosest, NumUp, NumDn

item_26 = ListItem(List=merge_2, Index=design_element_index, Wrap=True)
item_27 = ListItem(List=data_5, Index=flatten(info.Item), Wrap=True)
item_28 = ListItem(List=bbox_4.Box, Index=design_element_index, Wrap=True)

# ---- group: Pairs (Design & DB elements)
entwine_2 = Entwine(Branch00=item_26, Branch01=item_27, FlattenInputs=True)

# ---- group: Database Index
data_7 = Data(info.Item)

# ----
bbox_5 = BoundingBox(Content=merge_2, Plane=PlaneXY(0, 0, 0))  # -> Box, Box_2
number_slider_9 = Slider(4, range=0..10)
number_slider_10 = Slider(5, range=0..10)
addition_4 = Addition(A=number_slider_10, B=number_slider_9)
series_14 = Series(Start=0, Step=1, Count=number_slider_10)
series_15 = Series(Start=number_slider_10, Step=1, Count=number_slider_9)
series_16 = Series(Start=addition_4, Step=1, Count=Slider(4, range=0..10))
crossref = CrossReference(ListA=series_14, ListB="top", CrossMode=1)  # -> ListA, ListB
item_29 = ListItem(List=bbox_5.Box, Index=series_14, Wrap=True)
crossref_2 = CrossReference(ListA=series_15, ListB="side", CrossMode=1)  # -> ListA, ListB
crossref_3 = CrossReference(ListA=series_16, ListB="leg", CrossMode=1)  # -> ListA, ListB
item_30 = ListItem(List=bbox_5.Box, Index=series_15, Wrap=True)
item_31 = ListItem(List=bbox_5.Box, Index=series_16, Wrap=True)
# generating requirements (stool)
entwine_3 = Entwine(Branch00=item_29, Branch01=series_14, Branch02=crossref.ListB, FlattenInputs=True)
entwine_4 = Entwine(Branch00=item_30, Branch01=series_15, Branch02=crossref_2.ListB, FlattenInputs=True)
entwine_5 = Entwine(Branch00=item_31, Branch01=series_16, Branch02=crossref_3.ListB, FlattenInputs=True)
merge_4 = Merge(Data1=entwine_3, Data2=entwine_4, Data3=entwine_5)
branch_2 = TreeBranch(Tree=merge_4, Path="{0;0}", MaintainPaths=True)
branch_3 = TreeBranch(Tree=merge_4, Path="{0;1}", MaintainPaths=True)
branch_4 = TreeBranch(Tree=merge_4, Path="{0;2}", MaintainPaths=True)
int = Integer(branch_3)
int_2 = Integer(Slider(10, range=0..10))
get_string_4 = GetString(int_2, AtLeast=1, AtMost=1, TreeAccess=False)
addition_5 = Addition(A=int, B=1)
concat_4 = Concatenate(FragmentA="project_stool_", FragmentB=get_string_4)
panel_25 = Panel("http://localhost:5000/requirements/client")
lng_13 = ListLength(List=bbox_5.Box)
series_17 = Series(Start=0, Step=1, Count=lng_13)
panel_26 = Panel("application/json")
get_6 = GETRequest(URL=panel_25)  # -> Status, Content, Response; disabled
panel_27 = Panel(get_6.Content)

panel_28 = Panel("top")
panel_29 = Panel("side")
panel_30 = Panel("leg")
python_5 = GhPythonScript(key=panel_30, value=branch_4)  # -> out; inputs value: list
# ---------- python_5: Python ----------
__author__ = "jjooshe"
__version__ = "2023.06.07"

import rhinoscriptsyntax as rs
from ghpythonlib.treehelpers import list_to_tree 

output = []
for index, char in enumerate(value):
    if char == key:
        output.append(index)
        
out = list_to_tree(output)
# ---------- end python_5 ----------
python_6 = GhPythonScript(key="top", value=branch_4)  # -> out; inputs value: list; same code as python_5
python_7 = GhPythonScript(key="side", value=branch_4)  # -> out; inputs value: list; same code as python_5
item_32 = ListItem(List=branch_2, Index=python_6, Wrap=True)
item_33 = ListItem(List=branch_2, Index=python_7, Wrap=True)
item_34 = ListItem(List=branch_2, Index=python_5, Wrap=True)

debrep_13 = DeconstructBrep(Brep=item_32)  # -> Faces, Edges, Vertices
debrep_14 = DeconstructBrep(Brep=item_33)  # -> Faces, Edges, Vertices
debrep_15 = DeconstructBrep(Brep=item_34)  # -> Faces, Edges, Vertices
len_7 = Length(Curve=debrep_13.Edges)
len_8 = Length(Curve=debrep_14.Edges)
len_9 = Length(Curve=debrep_15.Edges)
cset_4 = CreateSet(List=len_8)  # -> Set, Map
cset_5 = CreateSet(List=len_9)  # -> Set, Map
cset_6 = CreateSet(List=len_7)  # -> Set, Map
item_35 = ListItem(List=cset_4.Set, Index=0, Wrap=True)  # -> flatten(Item), flatten(Item1), flatten(Item2)
item_36 = ListItem(List=cset_5.Set, Index=0, Wrap=True)  # -> flatten(Item), flatten(Item1), flatten(Item2)
item_37 = ListItem(List=cset_6.Set, Index=0, Wrap=True)  # -> flatten(Item), flatten(Item1), flatten(Item2)
merge_5 = Merge(Data1=item_37.Item, Data2=item_37.Item1, Data3=item_37.Item2)
merge_6 = Merge(Data1=item_35.Item, Data2=item_35.Item1, Data3=item_35.Item2)
merge_7 = Merge(Data1=item_36.Item, Data2=item_36.Item1, Data3=item_36.Item2)
sort_9 = SortList(Keys=merge_5)  # -> reverse(Keys), ValuesA
lng_14 = ListLength(List=item_32)
sort_10 = SortList(Keys=merge_6)  # -> reverse(Keys), ValuesA
lng_15 = ListLength(List=item_33)
sort_11 = SortList(Keys=merge_7)  # -> reverse(Keys), ValuesA
lng_16 = ListLength(List=item_34)
partition = PartitionList(List=sort_11.Keys, Size=lng_16)  # -> simplify(Chunks)
partition_2 = PartitionList(List=sort_9.Keys, Size=lng_14)  # -> simplify(Chunks)
partition_3 = PartitionList(List=sort_10.Keys, Size=lng_15)  # -> simplify(Chunks)
bang = ExplodeTree(Data=partition)  # -> Branch0, Branch1, Branch2
bang_2 = ExplodeTree(Data=partition_2)  # -> Branch0, Branch1, Branch2
bang_3 = ExplodeTree(Data=partition_3)  # -> Branch0, Branch1, Branch2
lengths_3 = Merge(Data1=bang_2.Branch0, Data2=bang_3.Branch0, Data3=bang.Branch0)
widths_2 = Merge(Data1=bang_2.Branch1, Data2=bang_3.Branch1, Data3=bang.Branch1)
heights = Merge(Data1=bang_2.Branch2, Data2=bang_3.Branch2, Data3=bang.Branch2)
python_8 = GhPythonScript(x=lengths_3, y=widths_2, z=heights)  # -> out, a, b, c
# ---------- python_8: Python ----------
a = round(x, 2)
b = round(y, 2)
c = round(z, 2)
# ---------- end python_8 ----------
rejson = SerializeJson(
    Part_index=addition_5,
    Length=python_8.a,
    Width=python_8.b,
    Height=python_8.c,
    Part=branch_4,
    Tag="chair",
    Project_id=concat_4,
    IncludeNullAndEmptyProperties=True)
item_38 = ListItem(List=rejson, Index=series_17, Wrap=True)
get_string_5 = GetString(item_38, AtLeast=1, AtMost=1, TreeAccess=False)
ctb_4 = CreateTextBody(
    Content=get_string_5,
    IsHtmlChecked=False,
    IsJavascriptChecked=False,
    IsJsonChecked=True,
    IsTextChecked=False,
    IsXmlChecked=False)
dam_6 = DataDam(DataA=ctb_4, BufferDelay=10000000, BufferMode=0)
post_2 = POSTRequest(URL=panel_25, Body=dam_6)  # -> Status, Content, Response; disabled
panel_31 = Panel(post_2.Content)

int_3 = Integer(toint.NumDn)
panel_32 = Panel([data_7, int_3])
panel_33 = Panel(toint.NumDn)

organize_data = GhPythonScript(ape=flatten(int_3), db_index=flatten(info.Item), remained_lengths=item_25)  # -> str_mapped_data, subtracting_length; inputs ape: list, db_index: list, remained_lengths: list
# ---------- organize_data: Python ----------
__author__ = "Javid Jooshesh"
__version__ = "2022.11.04"

import rhinoscriptsyntax as rs
import ghpythonlib.treehelpers as th
 

def map_data(param_1, param_2, param_3):
    """ Organize the given data as parameters. This function is used to
        organize the elements with the criteria of length and the factor of 
        APE (Amount Per Element). 
        
        param_1: A set from the list of APE as inputs
        param_2: List of indecies of usable elements from the database
        param_3: Remained length of the usable elements in the database at the
            index of `param_2`
        
        returns: Dictionary of the data organized in the following way:
                   {
                param_1: {
                    'index_list': [param_2],
                    'remained_lengths': [param_3]
                }
            }
    """
    hashtable = dict()
    FIRST_ARG = 0
    SECOND_ARG = 1
    data = zip(param_1, param_2, param_3)
            
    for i in range(len(param_1)):
        hashtable[param_1[i]] = {'index_list': [], 'remained_lengths': []}
                
    for i in range(len(data)):
        if data[i][FIRST_ARG] in hashtable.keys():
            hashtable[data[i][FIRST_ARG]]['index_list'].append(data[i][SECOND_ARG])
            hashtable[data[i][FIRST_ARG]]['remained_lengths'].append(param_3[i])
                    
    return hashtable
    
 
def run():
    mapped_data = map_data(ape, db_index, remained_lengths)
    str_mapped_data = str(map_data(ape, db_index, remained_lengths))

    amount_ = sorted(ape)[-1]
    print(amount_)
    
    subtracting_length = mapped_data[amount_]["remained_lengths"][0] / sorted(ape)[-1]
    print(subtracting_length)
    return str_mapped_data, subtracting_length


if __name__ == "__main__":
    
#    run()
    str_mapped_data = run()[0]
    subtracting_length = run()[1]
# ---------- end organize_data ----------
json = DeserializeKeysAndValues(JSON=organize_data.str_mapped_data)  # -> Key, Value
lastdex = LastIndex(List=json.Key)
panel_34 = Panel(organize_data.str_mapped_data)

# ----
# Take the index of elements in
# the database, and check per every
# design element indecies. Compare the
# length of each part, and evaluate how many parts are possible to get
# from each element in the database. (APE)
# 
# Create a Queue of elements to be used from the database.
# Once each element is dequeued from the task, the remaining length of the
# database element will be updated as it's original length will be deducted
# by the length of the design element which was cutout from it.
python_9 = GhPythonScript(
    des_index=design_element_index,
    lengths=item_23,
    db_index=flatten(info.Item),
    remained_lengths=item_25,
    ape=flatten(int_3),
    filtered_widths_indecies=cull_3)  # -> remaining_length, db_index_to_update; inputs des_index: list of Int32, lengths: list, db_index: list of Int32, remained_lengths: list, ape: list of Int32, filtered_widths_indecies: list
# ---------- python_9: Python ----------
"""
__Matching Algorithm__
__author__ = "Javid Jooshesh, j.jooshesh@hva.nl"
__version__ = "v1"
"""

        
class Node:
    def __init__(self, value):
        self.value = value
        self.next = None
        
        
class Queue:
    """_A class representing the Queue data structure based on the FIFO 
        (first in first out) principle_"""
            
    def __init__(self, value):
        """_Init method of the class_"""
                
        new_node = Node(value)
        self.first = new_node
        self.last = new_node
        self.length = 1
        
    def print_queue(self):
        """_A method to print the nodes of the queue_"""
                
        current = self.first
        while current:
            print(current.value)
            current = current.next
        
    def enqueue(self, value):
        """_Add a node to the queue_"""
                
        new_node = Node(value)
        if self.length == 0:
            self.first = new_node
            self.last = new_node
        else:
            self.last.next = new_node
            self.last = new_node
        self.length += 1
        
    def dequeue(self):
        """_Remove a node from the queue_"""
                
        if self.length == 0:
            return None
        current = self.first
        if self.length == 1:
            self.first = None
            self.last = None
        else:
            self.first = self.first.next
            current.next = None
        self.length -= 1
        return current
        

class PushDesignMethod:
    
    def __init__(self):
        self.ape = ape
        self.db_index = db_index
        self.remained_lengths = remained_lengths
        self.remainder = None
        self.lengths = lengths
        self.design_elements_index = None
        self.db_index_to_update = None
        self.des_index = des_index
        self.filtered_widths_indecies = filtered_widths_indecies
        self.selection_index = None
        self.queued_index = None
        
        self.q = Queue(None)
        self.updated_length = 0

    def update_length(self, subtracting_length, index):
        """ Update the length of part in the database via subtracting its length
        from the length of the design part
        """
        try:
            self.remained_lengths[index] -= subtracting_length
            return self.remained_lengths[index]
        except:
            msg = "### -----> Index is not in the list <----- ###"
            print(msg)
            return -1
    
    @classmethod
    def organize(cls, param_1, param_2, param_3):
        """ Organize the given data as parameters. This function is used to
            organize the elements with the criteria of length and the factor of 
            APE (Amount Per Element). 
            
            param_1: A set from the list of APE as inputs
            param_2: List of indecies of usable elements from the database
            param_3: Remained length of the usable elements in the database at the
                index of `param_2`
            
            returns: Dictionary of the data organized in the following way:
                       {
                    param_1: {
                        'index_list': [param_2],
                        'remained_lengths': [param_3]
                    }
                }
        """
        hashtable = dict()
        FIRST_ARG = 0
        SECOND_ARG = 1
        data = zip(param_1, param_2, param_3)
                
        for i in range(len(param_1)):
            hashtable[param_1[i]] = {'index_list': [], 'remained_lengths': []}
                    
        for i in range(len(data)):
            if data[i][FIRST_ARG] in hashtable.keys():
                hashtable[data[i][FIRST_ARG]]['index_list'].append(data[i][SECOND_ARG])
                hashtable[data[i][FIRST_ARG]]['remained_lengths'].append(param_3[i])
                        
        return hashtable

    def match_requirements(self):
        LAST_INDEX = -1
        FIRST_INDEX = 0
        
        data = self.organize(self.ape, self.db_index, self.remained_lengths)
        self.filtered_lengths_indecies = [data[key]['index_list'] for key in data]
        
        selected_ape = [k for k in data][LAST_INDEX] # e.g. 3
        print(selected_ape)
        
        self.db_index_to_update = data[selected_ape]['index_list'][0] # e.g. 12
        self.remainder = data[selected_ape]['remained_lengths'][0] # e.g. 1300.00
        
        self.lengths[0] # e.g. 357.00 updates by des_index change
        
        queued_index = self.filtered_widths_indecies[self.db_index_to_update] # 13
        
        # Have a for loop for all the parts in the design
            # Organize the part[i]
            # select the part with highest ape value
            # add the index of it to the q
            
            # run for loop iterating within (selected_ape) number of times: 
            # if part index is in q and the design part length is still less than
            # the database part's length at the q index: update remaining length
            # once break out of loop, remove the part from q
        # retun the final updated lengths of the part with index in the q

        node = []
        
        for key, value in data.items():
            if key == selected_ape:
                for index, item in enumerate(value['index_list']):
                    if index == FIRST_INDEX:
                        # Add the item and remained_lengths at the same index
                        # to the node as a tuple
                        node.append((item, value['remained_lengths'][index]))

        # Design Element Index
        dei = []
        # For now just working with one element. Later can be a list of lengths 
        for i in range(len(self.lengths)):
            for index, item in enumerate(self.db_index):
                
                if item == node[FIRST_INDEX][0]:
                    print(index, item)
                    # Update the length by subtracting the design element length
                    # from the database element length
                    self.updated_length = self.update_length(self.lengths[i], index)
                    dei.append(index)
    
            self.lengths.remove(self.lengths[i])
        self.q.print_queue()
        self.db_index_to_update = node[FIRST_INDEX][0]
        self.queued_index = queued_index
        self.design_elements_index = dei 
        return self.updated_length


if __name__ == "__main__":
    instance = PushDesignMethod()
    e = instance.match_requirements()
    print(e)
    remaining_length = e
    db_index_to_update = instance.queued_index
# ---------- end python_9 ----------

item_39 = ListItem(List=dejson_10.Length, Index=expr("x - 1", python_9.db_index_to_update), Wrap=True)
ape_2 = ListItem(List=json.Key, Index=lastdex, Wrap=True)
data_8 = Data(ape_2)
repeat = RepeatData(Data=milling_bit_radius, Length=data_8)
series_18 = Series(Start=design_element_index, Step=1, Count=data_8)
item_40 = ListItem(List=item_23, Index=series_18, Wrap=True)
cull_i_9 = CullIndex(List=merge_2, Indices=series_18, Wrap=True)
ma_5 = MassAddition(Input=[repeat, item_40])  # -> Result, PartialResults
data_9 = ListItem(List=json.Value, Index=ape_2, Wrap=True)
data_10 = Data(data_9)
subtraction_4 = Subtraction(A=item_39, B=ma_5.Result)

# ---- group: Update Database
# Production Server: https://robotlab-residualwood.onrender.com/residual_wood/
id_4 = Slider(3, range=0..10)
item_41 = ListItem(List=dejson_9, Index=expr("x - 1", python_9.db_index_to_update), Wrap=True)
dejsonkv_3 = DeserializeKeysAndValues(JSON=item_41)  # -> Key, Value
cull_i_10 = CullIndex(List=dejsonkv_3.Key, Indices=id_4, Wrap=True)
cull_i_11 = CullIndex(List=dejsonkv_3.Value, Indices=id_4, Wrap=True)
key_2 = Panel("length")
keysearch_3 = KeyValueSearch(Keys=cull_i_10, Values=cull_i_11, Search=key_2)
# To Rollback:
# Switch the BODY with DATA output
index_3 = ItemIndex(List=cull_i_11, Item=keysearch_3)
development_server_3 = Panel("http://127.0.0.1:5000/residual_wood/")
data_to_update = Panel(python_9.remaining_length)
replace_2 = ReplaceItems(List=cull_i_11, Item=python_9.remaining_length, Indices=index_3, Wrap=False)
rejsonkv_4 = SerializeKeysAndValues(Key=cull_i_10, Value=replace_2)
get_string_6 = GetString(rejsonkv_4, AtLeast=1, AtMost=2147483647, TreeAccess=False)
ctb_5 = CreateTextBody(
    Content=get_string_6,
    IsHtmlChecked=False,
    IsJavascriptChecked=False,
    IsJsonChecked=True,
    IsTextChecked=False,
    IsXmlChecked=False)
concat_5 = Concatenate(FragmentA=development_server, FragmentB=python_9.db_index_to_update)  # -> graft(Result)

# ----
item_42 = ListItem(List=move_4.Geometry, Index=expr("x - 1", python_9.db_index_to_update), Wrap=True)
bbox_6 = BoundingBox(Content=item_42, Plane=PlaneXY(0, 0, 0))  # -> Box, Box_2
int_4 = Integer(item_23)
debrep_16 = DeconstructBrep(Brep=bbox_6.Box)  # -> Faces, Edges, Vertices
item_43 = ListItem(List=debrep_16.Edges, Index=0, Wrap=True)
Y_6 = UnitY(Factor=1)
subtraction_5 = Subtraction(A=int_4, B=milling_bit_radius)
divlength = DivideLength(Curve=item_43, Length=int_4)  # -> Points, Tangents, Parameters
len_10 = Length(Curve=item_43)
addition_6 = Addition(A=int_4, B=milling_bit_radius)
division_6 = Division(A=len_10, B=addition_6)
line = LineSDL(Start=divlength.Points, Direction=Y_6, Length=Slider(166, range=0..200))
panel_35 = Panel(division_6)
Z = UnitZ(Factor=Slider(100, range=0..100))
extr = Extrude(Base=line, Direction=Z)
X = UnitX(Factor=milling_bit_radius)
extr_2 = Extrude(Base=extr, Direction=X)
sdiff = SolidDifference(BrepsA=graft(bbox_6.Box), BrepsB=extr_2)  # -> simplify(Result)
bang_4 = ExplodeTree(Data=sdiff)
debrep_17 = DeconstructBrep(Brep=bang_4)  # -> Faces, Edges, Vertices
len_11 = Length(Curve=debrep_17.Edges)
cset_7 = CreateSet(List=len_11)  # -> Set, Map
sort_12 = SortList(Keys=cset_7.Set)  # -> reverse(Keys), ValuesA
item_44 = ListItem(List=sort_12.Keys, Index=0, Wrap=True)
int_5 = Integer(item_44)
equals = Equality(FirstNumber=flatten(int_5), SecondNumber=subtraction_5)  # -> Equality, Inequality
cull_5 = CullPattern(List=bang_4, CullPattern=equals.Equality)

# ----
# 50 ms
# Once ready, click the Datadam
# to update the database
dam_7 = DataDam(DataB=concat_5, DataA=ctb_5, BufferDelay=5000000, BufferMode=0)  # -> DataB, DataA
put_2 = PUTRequest(URL=dam_7.DataB, Body=dam_7.DataA)  # -> Status, Content, flatten(Response); disabled
panel_36 = Panel(put_2.Response)

flatten_6 = FlattenTree(Tree=ctb_5, Path="{0}")
flatten_7 = FlattenTree(Tree=concat_5, Path="{0}")
panel_37 = Panel(flatten_7)
panel_38 = Panel(flatten_6)

sort_13 = SortList(Keys=dejson_7.Id, ValuesA=boxrec_3)  # -> Keys, ValuesA; disabled
cset_8 = CreateSet(List=item_18)  # -> Set, Map; disabled
lng_17 = ListLength(List=cset_8.Set)  # disabled

clean = CleanTree(RemoveNulls=True, RemoveInvalid=True, RemoveEmpty=invert(False), Tree=simplify(python_3.ratios))  # disabled
data_11 = Data(sort_7.ValuesA)  # disabled
item_45 = ListItem(List=clean, Index=0, Wrap=True)  # -> flatten(Item), flatten(Item1); disabled
sort_14 = SortList(Lengths=item_45.Item1, ValuesBlocks=item_45.Item)  # -> Sorted_lengths, ValuesBlocks; disabled
sort_15 = SortList(Keys=python_3.available_length)  # -> Keys, ValuesA; disabled

# ---- group: ANALYTICS
number_slider_11 = Slider(0.4, range=0..1)  # disabled
eval_3 = EvaluateCurve(Curve=reparameterize(data_11), Parameter=number_slider_11)  # -> Point, Tangent, Angle; disabled
midpt = CurveMiddle(Curve=data_11)  # disabled
move_5 = Move(Geometry=eval_3.Point, Motion=Vector(0, 0, 10))  # -> Geometry, Transform; disabled
sort_16 = SortList(Keys=sort_15.Keys, ValuesA=midpt)  # -> Keys, ValuesA; disabled
python_10 = GhPythonScript(anchor=sort_15.Keys, data=sort_14.Sorted_lengths)  # -> a; inputs anchor: list, data: list; disabled
# ---------- python_10: Python ----------
"""_Analitics_"""

def analyze(anchor, data):

    values = tuple(zip(anchor, data))
    diff = [values[i][1] - values[i][0] for i in range(len(anchor))]
    
    percentages = [
            "% " + str(round((diff[i] / anchor[i]) * 100, 2))
            for i in range(len(anchor))
        ]
    return percentages

a = analyze(anchor, data)
# ---------- end python_10 ----------
yz = YZPlane(Origin=sort_16.ValuesA)  # disabled
swatch = ColourSwatch(SwatchColor=RGB(255, 255, 255))  # disabled
data_12 = Data(item_17)  # disabled
txt = Text(data_12)  # disabled
number_slider_12 = Slider(1.646, range=0..10)  # disabled
swatch_2 = ColourSwatch(SwatchColor=RGB(0, 255, 229))  # disabled
tag_4 = TextTag(Location=yz, Text=python_10, Colour=swatch)  # disabled
yz_2 = YZPlane(Origin=move_5.Geometry)  # disabled
tag_5 = TextTag3D(Location=yz_2, Text=txt, Size=number_slider_12, Colour=swatch_2, Justification=7)  # disabled

# ---- group: Find closest lengths
python_11 = GhPythonScript(design_lengths=sort_15.Keys, database_lengths=item_45.Item1)  # -> nearest_lengths; inputs design_lengths: list, database_lengths: list; disabled; same code as python_2

# ----
keysearch_4 = KeyValueSearch(Keys=sort_14.Sorted_lengths, Values=sort_14.ValuesBlocks, Search=python_11)  # disabled
index_4 = ItemIndex(List=python_3.all_blocks, Item=keysearch_4)  # disabled

data_13 = Data(keysearch_4)  # disabled
debrep_18 = DeconstructBrep(Brep=data_13)  # -> Faces, Edges, Vertices; disabled
item_46 = ListItem(List=debrep_18.Faces, Index=0, Wrap=True)  # -> Item, Item1; disabled
md_slider = MDSlider(
    SliderMode=0,
    slider_value=Point(0.5010223389, 0.5010242462, 0.5),
    x_domain=Domain(0, 1),
    y_domain=Domain(0, 1),
    z_domain=Domain(0, 1))  # disabled
data_14 = Data(item_46.Item1)  # disabled
evalsrf = EvaluateSurface(Surface=reparameterize(data_14), Point=md_slider)  # -> Point, Normal, UDirection, VDirection, Frame; disabled
number_slider_13 = Slider(90, range=-90..90)  # disabled
pflip_2 = FlipPlane(Plane=data_11, ReverseX=False, ReverseY=False, SwapAxes=True)  # disabled
prot = RotatePlane(Plane=pflip_2, Angle=degrees(number_slider_13))  # disabled
orient_3 = Orient(Geometry=data_13, Source=flatten(evalsrf.Frame), Target=prot)  # -> Geometry, Transform; disabled

# ---- group: OUTPUT TO BAKE
geo_2 = Geometry(orient_3.Geometry)  # disabled

# ----
lng_18 = ListLength(List=orient_3.Geometry)  # disabled
min_3 = Minimum(A=lng_17, B=lng_18)  # disabled
series_19 = Series(Start=0, Step=1, Count=min_3)  # disabled
item_47 = ListItem(List=orient_3.Geometry, Index=series_19, Wrap=True)  # disabled
replace_3 = ReplaceItems(List=python_3.all_blocks, Item=item_47, Indices=cset_8.Set, Wrap=False)  # disabled
preview_5 = CustomPreview(Geometry=replace_3, Material=cluster_3.C)  # disabled
preview_6 = CustomPreview(Geometry=geo_2, Material=cluster_3.C)  # disabled

# ---- group: API call to remove the used wood based on ID (continued)
item_48 = ListItem(List=dejson_7.Id, Index=index_4, Wrap=True)  # disabled

# ---- group: API call to remove the used wood based on ID / Removed Indecies
data_15 = Data(item_48)  # disabled

# ---- group: API call to remove the used wood based on ID (continued)
concat_6 = Concatenate(FragmentA=panel_22, FragmentB=panel_23, FragmentA_2=data_15)  # disabled
delete_2 = DELETERequest(URL=concat_6)  # -> Status, Content, Response; disabled
panel_39 = Panel(delete_2.Response)  # disabled

# ==== cluster Cluster
count = ClusterInput()

vb = VBScript(genelist="GeneList D", count=count)  # -> out, A
# ---------- vb: VB ----------
    For Each obj As IGH_DocumentObject In owner.OnPingDocument().Objects
      If (obj.ComponentGuid <> New Guid("{21553c44-ea62-475e-a8bb-62b2a3ee5ca5}")) Then Continue For
      If (obj.NickName Like genelist) Then
        CallByName(obj, "Count", CallType.Set, count)
        'CallByName(obj, "ExpireSolution", CallType.Method, False)
        Return
      End If
    Next

    Print("No matching Gene list object found")
# ---------- end vb ----------
vb_2 = VBScript(genelist="GeneList E", count=count)  # -> out, A; same code as vb
vb_3 = VBScript(genelist="GeneList F", count=count)  # -> out, A; same code as vb
vb_4 = VBScript(genelist="GeneList G", count=count)  # -> out, A; same code as vb
genelist_d = GeneList(
    Decimals=2,
    Maximum=255,
    Minimum=200,
    Value=[249.6870825, 227.159727, 220.7125882, 221.879463, 240.3877779, 247.7977078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])
genelist_e = GeneList(
    Decimals=2,
    Maximum=140,
    Minimum=120,
    Value=[123.301908, 126.2742014, 136.988057, 120.8476593, 139.8469819, 137.5064603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])
genelist_f = GeneList(
    Decimals=2,
    Maximum=90,
    Minimum=20,
    Value=[47.66573956, 64.54453612, 31.81359346, 80.80078899, 53.74216505, 67.76083834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])
genelist_g = GeneList(
    Decimals=2,
    Maximum=1000,
    Minimum=120,
    Value=[449.58535, 864.1659569, 128.0886553, 422.1313001, 285.0884081, 694.9051328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])
rgb = ColourRGB(Alpha=150, Red=genelist_d, Green=genelist_e, Blue=genelist_f)

vb_5 = VBScript(genelist="GeneList B", count=count)  # -> out, A; same code as vb
vb_6 = VBScript(genelist="GeneList A", count=count)  # -> out, A; same code as vb
vb_7 = VBScript(genelist="GeneList C", count=count)  # -> out, A; same code as vb
genelist_g_2 = ClusterOutput(genelist_g)

genelist_b = GeneList(
    Decimals=2,
    Maximum=25,
    Minimum=10,
    Value=[12.59518988, 16.61877447, 15.3142289, 23.44315202, 20.79544497, 15.52627439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])
genelist_a = GeneList(
    Decimals=2,
    Maximum=35,
    Minimum=30,
    Value=[33.88890474, 34.71611187, 30.6836495, 30.45055322, 32.85169996, 30.87290662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])
genelist_c = GeneList(
    Decimals=2,
    Maximum=3,
    Minimum=2,
    Value=[2.357290426, 2.185102099, 2.981203596, 2.288344855, 2.073907413, 2.381113439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])

C = ClusterOutput(rgb)
genelist_b_2 = ClusterOutput(genelist_b)
genelist_a_2 = ClusterOutput(genelist_a)
genelist_c_2 = ClusterOutput(genelist_c)

# ==== cluster Cluster_2
C = ClusterInput()
C_2 = ClusterInput()
C_3 = ClusterInput()
bbox = BoundingBox(Content=C, Plane=PlaneXY(0, 0, 0))  # -> Box, Box_2
bbox_2 = BoundingBox(Content=C_2, Plane=PlaneXY(0, 0, 0))  # -> Box, Box_2
bbox_3 = BoundingBox(Content=C_3, Plane=PlaneXY(0, 0, 0))  # -> Box, Box_2
debrep = DeconstructBrep(Brep=bbox.Box)  # -> Faces, Edges, Vertices
debrep_2 = DeconstructBrep(Brep=bbox_2.Box)  # -> Faces, Edges, Vertices
debrep_3 = DeconstructBrep(Brep=bbox_3.Box)  # -> Faces, Edges, Vertices
len = Length(Curve=debrep.Edges)
len_2 = Length(Curve=debrep_2.Edges)
len_3 = Length(Curve=debrep_3.Edges)
cset = CreateSet(List=len)  # -> Set, Map
cset_2 = CreateSet(List=len_2)  # -> Set, Map
cset_3 = CreateSet(List=len_3)  # -> Set, Map
sort = SortList(Keys=cset.Set)  # -> Keys, ValuesA
sort_2 = SortList(Keys=cset_2.Set)  # -> Keys, ValuesA
sort_3 = SortList(Keys=cset_3.Set)  # -> Keys, ValuesA
rev = ReverseList(List=sort.Keys)
rev_2 = ReverseList(List=sort_2.Keys)
rev_3 = ReverseList(List=sort_3.Keys)
item = ListItem(List=rev, Index=0, Wrap=True)  # -> flatten(Item)
item_2 = ListItem(List=rev_2, Index=0, Wrap=True)  # -> flatten(Item)
item_3 = ListItem(List=rev_3, Index=0, Wrap=True)  # -> flatten(Item)
merge = Merge(Data1=item, Data2=item_2, Data3=item_3)
R = ClusterOutput(merge)
number_slider = ClusterOutput(Slider(2, range=0..10))

# ==== cluster Cluster_3
B = ClusterInput()
debrep = DeconstructBrep(Brep=B)  # -> Faces, Edges, Vertices
len = Length(Curve=debrep.Edges)
cset = CreateSet(List=len)  # -> Set, Map
sort = SortList(Keys=cset.Set)  # -> Keys, ValuesA
item = ListItem(List=reverse(sort.Keys), Index=0, Wrap=True)
item_2 = ListItem(List=reverse(sort.Keys), Index=1, Wrap=True)
item_3 = ListItem(List=reverse(sort.Keys), Index=2, Wrap=True)
i = ClusterOutput(item)
i_2 = ClusterOutput(item_2)
i_3 = ClusterOutput(item_3)
